# Grasshopper definition SurfaceTempVIS.gh (Grasshopper 0.9.76)
# Copyright: Transsolar
# plug-ins: Python Interpreter

# ---- group: SMALL MODEL
panel = Panel("c:\Users\vhoang\Desktop\LizardSurfTemp\TRNLizard_Files\Model\")
panel_2 = Panel("C:\Users\Vu Hoang\Desktop\LizardSurfTemp\TRNLizard_Files\Model\")
timestep = Slider(4436, range=1..8760)
python = PythonScript(ModelPath=panel, Variant="BASIS2", TimeStep=timestep)  # -> SrfTempTimeStep, newSurf, b18path
# ---------- python: Python ----------
"""
This function look, read AddOutput_1h.prn
Returning {ID:temperature}
"""
import os
import re
import Rhino as rc
import Grasshopper as gh

ModelPath = ModelPath #"c:\\Users\\vhoang\\Desktop\\LizardSurfTemp\\TRNLizard_Files\\Model\\" #this will be an input from GH component in the future
Variant = Variant #"BASIS2" #this will be an input from GH component in the future
AddOutputPath = os.path.join(ModelPath,Variant,"Results\\AddOutput_1h.prn")
b18path = os.path.join(ModelPath,Variant,"%s.b18"%Variant)

TimeStep = int(TimeStep) #1

def readSurfaceTemp(AddOutputPath,TimeStep):
    """Read in AddOutput_1h.prn
    Return a dictionary {surfacename:[hourly values]}
    Sorted based on surface ID, lower to higher"""
    if not os.path.isfile(AddOutputPath):
        print("AddOutput_1h.prn file not found! Please check if you have surface temperature connected as additional output!")
        pass
    else:
        SurfTempF = open(AddOutputPath,'r')
        SurfTempLines = SurfTempF.readlines()
        #take first line to get surface name and ID
        firstline = SurfTempLines[0].split()
        srfname, srfID = [], []
        SurfaceTemperature = dict() #{srfname:[hourly surface temperature]}
        for item in firstline:
            itemname = item.split("_")[-1]
            itemid = int(item.split("_S")[-1])
            srfname.append(itemname)
            srfID.append(itemid)
            SurfaceTemperature[itemid] = [] #empty list later to store hourly temperature
        SurfTempLines.pop(0)
        SurfTempLines.pop(0)
        hour = []
        for line in SurfTempLines:
            line = line.split()
            try:
                hour.append(float(line[0]))
                line.pop(0)
                for id,values in enumerate(line):
                    SurfaceTemperature[srfID[id]].append(float(values))
            except:
                break
        SurfTempF.close()
        #now get all the temperature at timestep
        SrfTempAtTimeStep = []
        for key in sorted(SurfaceTemperature.keys()):
            #print key
            SrfTempAtTimeStep.append(SurfaceTemperature[key][TimeStep-1]) #sorted smaller id to higher id
        return SurfaceTemperature, SrfTempAtTimeStep

def getDataParagraph(startpattern,stoppattern,datararray):
    """by Mark Sen Dong for TRNLizard b18 geometry visualization
    Get paragraph between start and stop pattern"""
    output = []
    inparagraph = 'FALSE'
    lines=datararray
    for i in range(len(lines)):
        search_start=re.search(r'{0}'.format(startpattern),lines[i])
        if search_start is not None or inparagraph == 'TRUE':
            inparagraph = 'TRUE'
            lines[i] = lines[i].split('\n')[0]
            if lines[i].startswith('*'):
                pass
            else:
                output.append(lines[i])
            search_stop=re.search(r'{0}'.format(stoppattern),lines[i])
            if search_stop is not None:
                return output
                pass

def readSurfaceGeo(b18path):
    """Read b18 building file
    Return surface and vertices, as well as construction"""
    if not os.path.isfile(b18path):
        print("b18 building file not found! Please check!")
        pass
    else:
        b18file = open(b18path,"r")
        b18data = b18file.readlines()
        srfGeoBlock = getDataParagraph("_EXTENSION_BuildingGeometry_START_", "_EXTENSION_BuildingGeometry_END_", b18data)
        #now get vertex's coordinate xyz
        vertexdict = dict() #{vertexID:[x,y,z]}
        srfbasicinfo = dict() #{surfaceID:[vertexID]}
        srfInfo = dict() #{surfaceID:[vertices coordinate]}
        for line in srfGeoBlock:
            dline = line.split()
            if "vertex" in dline:
                vertexdict[int(dline[1])] = [float(xyz) for xyz in dline[2:]] #{vertexID:[x,y,z]}
            if "wall" in dline or "window" in dline or "floor" in dline or "ceiling" in dline or "roof" in dline:
                srfbasicinfo[int(dline[1])] = [[int(nrID) for nrID in dline[2:]],dline[0]] #{surfaceID:[[vertexID],construction]}
                #print srfbasicinfo[int(dline[1])]
        for key in srfbasicinfo.keys():
            srfInfo[key] = []
            for vertices in srfbasicinfo[key][0]:
                srfInfo[key].append(vertexdict[vertices])
        b18file.close()
        return srfInfo,vertexdict,srfbasicinfo
        #actually only need srfInfo
        #just getting everything out for now, incase will need to use those

def verticesToSurface(verticesList):
    """Mark Sen Dong
    Turning list of vertices with coordinate into brep"""
    ptslst = list()
    #print verticesList
    for ptsxyz in verticesList:
        pts = rc.Geometry.Point3d(ptsxyz[0],ptsxyz[1],ptsxyz[2])
        ptslst.append(pts)
    ptslst.append(ptslst[0])
    #print ptslst
    polyline = rc.Geometry.Polyline(ptslst)
    #return polyline
    return rc.Geometry.Brep.CreatePlanarBreps(polyline.ToNurbsCurve())

def listToTree(nestedList):
    """Anders Holder Deleuran
    Convert list to datatree"""
    dt = gh.DataTree[object]()
    for i,l in enumerate(nestedList):
        dt.AddRange(l,gh.Kernel.Data.GH_Path(i))
    return dt

SrfTempAll, SrfTempTimeStep = readSurfaceTemp(AddOutputPath, TimeStep)
srfInfo, vertexdict, srfbasicinfo = readSurfaceGeo(b18path)

#get breps 
Surfaces = list()
for key in sorted(srfInfo.keys()):
    brep = verticesToSurface(srfInfo[key])
    Surfaces.append(brep)
newSurf = listToTree(Surfaces)
# ---------- end python ----------
brep = Brep(flatten(python.newSurf))
panel_3 = Panel(python.SrfTempTimeStep)

# ---- group: BIGGER MODEL
panel_5 = Panel("c:\Users\vhoang\Desktop\LizardSurfTemp\TRNLizard_Files\Multizones_model\Model\")
timestep_2 = Slider(5000, range=1..8760)
python_2 = PythonScript(ModelPath=panel_5, Variant="BIGGER_MODEL", TimeStep=timestep_2)  # -> SrfTempTimeStep, newSurf, b18path
# ---------- python_2: Python ----------
"""
This function look, read AddOutput_1h.prn
Returning {ID:temperature}
"""
import os
import re
import Rhino as rc
import Grasshopper as gh
import rhinoscriptsyntax as rs

ModelPath = ModelPath #"c:\\Users\\vhoang\\Desktop\\LizardSurfTemp\\TRNLizard_Files\\Model\\" #this will be an input from GH component in the future
Variant = Variant #"BASIS2" #this will be an input from GH component in the future
AddOutputPath = os.path.join(ModelPath,Variant,"Results\\AddOutput_1h.prn")
b18path = os.path.join(ModelPath,Variant,"%s.b18"%Variant)

TimeStep = int(TimeStep) #1

def readSurfaceTemp(AddOutputPath,TimeStep):
    """Read in AddOutput_1h.prn
    Return a dictionary {surfacename:[hourly values]}
    Sorted based on surface ID, lower to higher"""
    if not os.path.isfile(AddOutputPath):
        print("AddOutput_1h.prn file not found! Please check if you have surface temperature connected as additional output!")
        pass
    else:
        SurfTempF = open(AddOutputPath,'r')
        SurfTempLines = SurfTempF.readlines()
        #take first line to get surface name and ID
        firstline = SurfTempLines[0].split()
        srfname, srfID = [], []
        SurfaceTemperature = dict() #{srfname:[hourly surface temperature]}
        for item in firstline:
            itemname = item.split("_")[-1]
            itemid = int(item.split("_S")[-1])
            srfname.append(itemname)
            srfID.append(itemid)
            SurfaceTemperature[itemid] = [] #empty list later to store hourly temperature
        SurfTempLines.pop(0)
        SurfTempLines.pop(0)
        hour = []
        for line in SurfTempLines:
            line = line.split()
            try:
                hour.append(float(line[0]))
                line.pop(0)
                for id,values in enumerate(line):
                    SurfaceTemperature[srfID[id]].append(float(values))
            except:
                break
        SurfTempF.close()
        #now get all the temperature at timestep
        SrfTempAtTimeStep = []
        for key in sorted(SurfaceTemperature.keys()):
            #print key
            SrfTempAtTimeStep.append(SurfaceTemperature[key][TimeStep-1]) #sorted smaller id to higher id
        return SurfaceTemperature, SrfTempAtTimeStep

def getDataParagraph(startpattern,stoppattern,datararray):
    """by Mark Sen Dong for TRNLizard b18 geometry visualization
    Get paragraph between start and stop pattern"""
    output = []
    inparagraph = 'FALSE'
    lines=datararray
    for i in range(len(lines)):
        search_start=re.search(r'{0}'.format(startpattern),lines[i])
        if search_start is not None or inparagraph == 'TRUE':
            inparagraph = 'TRUE'
            lines[i] = lines[i].split('\n')[0]
            if lines[i].startswith('*'):
                pass
            else:
                output.append(lines[i])
            search_stop=re.search(r'{0}'.format(stoppattern),lines[i])
            if search_stop is not None:
                return output
                pass

def readSurfaceGeo(b18path):
    """Read b18 building file
    Return surface and vertices, as well as construction"""
    if not os.path.isfile(b18path):
        print("b18 building file not found! Please check!")
        pass
    else:
        b18file = open(b18path,"r")
        b18data = b18file.readlines()
        srfGeoBlock = getDataParagraph("_EXTENSION_BuildingGeometry_START_", "_EXTENSION_BuildingGeometry_END_", b18data)
        #now get vertex's coordinate xyz
        vertexdict = dict() #{vertexID:[x,y,z]}
        srfbasicinfo = dict() #{surfaceID:[vertexID]}
        srfInfo = dict() #{surfaceID:[vertices coordinate]}
        for line in srfGeoBlock:
            dline = line.split()
            if "vertex" in dline:
                vertexdict[int(dline[1])] = [float(xyz) for xyz in dline[2:]] #{vertexID:[x,y,z]}
            if "wall" in dline or "window" in dline or "floor" in dline or "ceiling" in dline or "roof" in dline:
                srfbasicinfo[int(dline[1])] = [[int(nrID) for nrID in dline[2:]],dline[0]] #{surfaceID:[[vertexID],construction]}
                #print srfbasicinfo[int(dline[1])]
        for key in srfbasicinfo.keys():
            srfInfo[key] = []
            for vertices in srfbasicinfo[key][0]:
                srfInfo[key].append(vertexdict[vertices])
        b18file.close()
        return srfInfo,vertexdict,srfbasicinfo
        #actually only need srfInfo
        #just getting everything out for now, incase will need to use those

def verticesToSurface(verticesList):
    """Mark Sen Dong
    Turning list of vertices with coordinate into brep"""
    ptslst = list()
    #print verticesList
    for ptsxyz in verticesList:
        pts = rc.Geometry.Point3d(ptsxyz[0],ptsxyz[1],ptsxyz[2])
        ptslst.append(pts)
    ptslst.append(ptslst[0])
    #print ptslst
    polyline = rc.Geometry.Polyline(ptslst)
    #return polyline
    return rc.Geometry.Brep.CreatePlanarBreps(polyline.ToNurbsCurve())

def listToTree(nestedList):
    """Anders Holder Deleuran
    Convert list to datatree"""
    dt = gh.DataTree[object]()
    for i,l in enumerate(nestedList):
        dt.AddRange(l,gh.Kernel.Data.GH_Path(i))
    return dt

SrfTempAll, SrfTempTimeStep = readSurfaceTemp(AddOutputPath, TimeStep)
srfInfo, vertexdict, srfbasicinfo = readSurfaceGeo(b18path)

#get breps 
Surfaces = list()
SurfacesDict = dict() #{surfaceID: [tpye,brep]}
for key in sorted(srfInfo.keys()):
    brep = verticesToSurface(srfInfo[key])
    Surfaces.append(brep) #original breps
    SurfacesDict[key] = [srfbasicinfo[key][-1]]
    SurfacesDict[key].append(brep)

newSurf = listToTree(Surfaces)
# ---------- end python_2 ----------
brep_2 = Brep(flatten(python_2.newSurf))
panel_6 = Panel(python_2.SrfTempTimeStep)

# ----
brep_3 = Brep(brep_2)
facen = FaceNormals(Mesh=flatten(brep_3))  # -> Centers, Normals
item = ListItem(List=facen.Normals, Index=0, Wrap=True)
multiplication = Multiplication(A=item, B=Slider(1, range=0..10))
move = Move(Geometry=flatten(brep_3), Motion=flatten(multiplication))  # -> Geometry, Transform

# ---- group: color assignment
python_3 = PythonScript(x=python_2.SrfTempTimeStep)  # -> MiN, MaX; inputs x: list
# ---------- python_3: Python ----------
MaX = max(x) + 0.01
MiN = min(x) -0.01
# ---------- end python_3 ----------
panel_7 = Panel("16")
panel_8 = Panel("23")
gradient = Gradient(
    LowerLimit=python_3.MiN,
    UpperLimit=python_3.MaX,
    Parameter=python_2.SrfTempTimeStep,
    stops=[0: RGB(76, 64, 148), 0: RGB(58, 80, 112), 0: RGB(108, 247, 74), 0: RGB(251, 27, 201), 0: RGB(41, 178, 230), 0: RGB(222, 88, 226), 0: RGB(248, 5, 194), 0.252: RGB(0, 30, 255), 0.501: RGB(0, 151, 0), 0.746: RGB(255, 0, 0), 1: RGB(255, 255, 0)])
preview = CustomPreview(Geometry=move.Geometry, Shader=gradient)
